# Grasshopper definition display_results.gh (Grasshopper 1.0.7)

panel = Panel("https://www.energyplus.net/weather-download/europe_wmo_region_6/DNK//DNK_Copenhagen.061800_IWEC/all")
panel_2 = Panel("C:\Users\Pedersen_Admin\OneDrive - Perkins and Will\Documents\GitHub\VMT\examples\example1")
downloadepw = LBDownloadWeather(weather_URL=panel)  # -> epw_file, stat_file, ddy_file; plug-in component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
importepw = LBImportEPW(epw_file=downloadepw.epw_file)  # -> location, dry_bulb_temperature, dew_point_temperature, relative_humidity, wind_speed, wind_direction, direct_normal_rad, diffuse_horizontal_rad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; plug-in component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

# ---- group: Export volume massing to rad
# Display example
panel_3 = Panel("volume_massing_facades.rad")
concat = Concatenate(FragmentA=panel_2, FragmentB="\", FragmentC=panel_3)
importrad = Honeybee_ImportRad(radianceFile=concat)  # -> RADMaterials, RADSurfaces; plug-in component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

# ---- group: Export rest of volume massing to rad
concat_2 = Concatenate(FragmentA=panel_2, FragmentB="\", FragmentC="volume_massing_rest.rad")
importrad_2 = Honeybee_ImportRad(radianceFile=concat_2)  # -> RADMaterials, RADSurfaces; plug-in component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

# ----
importloc = LBImportLocation(epw_file=downloadepw.epw_file)  # -> location; plug-in component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

# ---- group: Export context to rad
concat_3 = Concatenate(FragmentA=panel_2, FragmentB="\", FragmentC="context.rad")
importrad_3 = Honeybee_ImportRad(radianceFile=concat_3)  # -> RADMaterials, RADSurfaces; plug-in component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

# ----
number_slider = Slider(2625, range=0..8760)
skymatrix = LBCumulativeSkyMatrix(location=importloc, direct_rad=importepw.direct_normal_rad, diffuse_rad=importepw.diffuse_horizontal_rad)  # -> report, sky_mtx; plug-in component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

edges = BrepEdges(Brep=importrad_3.RADSurfaces)  # -> Naked, Interior, NonManifold
edges_2 = BrepEdges(Brep=importrad.RADSurfaces)  # -> Naked, Interior, NonManifold
edges_3 = BrepEdges(Brep=importrad_2.RADSurfaces)  # -> Naked, Interior, NonManifold
preview = CustomPreview(Geometry=importrad.RADSurfaces, Material=ColourSwatch(SwatchColor=RGBA(255, 0, 42, 157)))
preview_2 = CustomPreview(Geometry=importrad_2.RADSurfaces, Material=ColourSwatch(SwatchColor=RGBA(0, 153, 255, 157)))
preview_3 = CustomPreview(Geometry=importrad_3.RADSurfaces, Material=ColourSwatch(SwatchColor=RGBA(255, 255, 255, 226)))
preview_4 = CustomPreview(Geometry=edges.Naked, Material=ColourSwatch(SwatchColor=RGB(0, 0, 0)))

skydome = LBSkyDome(sky_mtx=skymatrix.sky_mtx)  # -> report, mesh, compass, legend, title, patch_vecs, patch_values, mesh_values; plug-in component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

# ----
# VMT tool radiation output
panel_4 = Panel("C:\baseline_test\radiation_analysis")
toggle = BooleanToggle(True)

# ---- group: Data load
panel_5 = Panel("""\output\result_cummulative_0.txt
\output\result_cummulative_1.txt
\output\result_cummulative_2.txt
\output\result_cummulative_3.txt""")
panel_6 = Panel("""\output\clustering_label_0.txt
\output\clustering_label_1.txt
\output\clustering_label_2.txt
\output\clustering_label_3.txt""")
panel_7 = Panel("""\output\clustering_center_0.txt
\output\clustering_center_1.txt
\output\clustering_center_2.txt
\output\clustering_center_3.txt""")
panel_8 = Panel("""\mesh\mesh_0.txt
\mesh\mesh_1.txt
\mesh\mesh_2.txt
\mesh\mesh_3.txt""")
concat_4 = Concatenate(FragmentA=panel_4, FragmentB="\pts\points_all.pts")
concat_5 = Concatenate(FragmentA=panel_4, FragmentB=panel_5)
concat_6 = Concatenate(FragmentA=panel_4, FragmentB=panel_8)
concat_7 = Concatenate(FragmentA=panel_4, FragmentB=panel_6)
concat_8 = Concatenate(FragmentA=panel_4, FragmentB=panel_7)
python = GhPythonScript(all_points_file=concat_4, run=toggle)  # -> out, P, N
# ---------- python: Python ----------
__author__ = "Pedersen_Admin"
__version__ = "2021.02.10"

import rhinoscriptsyntax as rs
import os 

if run:
    P = []
    N = []
    with open(all_points_file, "r") as infile:
        content = infile.readlines()
        
    for i in range(len(content)):
        try:
            numbers = content[i].split(" ")
            print(numbers)
            P.append(rs.AddPoint(float(numbers[0]),float(numbers[1]),float(numbers[2])))
            
            N.append(rs.AddPoint(float(numbers[3]),float(numbers[4]),float(numbers[5])))
            
        except: #Last line
            pass
# ---------- end python ----------
python_2 = GhPythonScript(mesh_files=concat_6, run=toggle)  # -> out, M
# ---------- python_2: Python ----------
__author__ = "Pedersen_Admin"
__version__ = "2021.02.10"

import rhinoscriptsyntax as rs
import os 

if run:
    V = []
    F = []
    with open(mesh_files, "r") as infile:
        content = infile.readlines()
    
    read_vertices = False
    read_fases = False
    for j in range(len(content)):
        
        if "### Mesh vertices" in content[j]:
            read_vertices = True
            read_fases = False
            continue
            
        elif "### Mesh faces" in content[j]:
            read_vertices = False
            read_fases = True
            continue
        
        if read_vertices:
            numbers = content[j].split(" ")
            V.append((float(numbers[0]),
            float(numbers[1]),
            float(numbers[2])))
            
        elif read_fases:
            numbers = content[j].split(" ")
            F.append((int(numbers[0]),
            int(numbers[1]),
            int(numbers[2]),
            int(numbers[3])))
    
    M = rs.AddMesh(V,F) #https://discourse.mcneel.com/t/creating-meshes-from-scratch/22504/2
# ---------- end python_2 ----------
python_3 = GhPythonScript(cummulative_results_file=concat_5, run=toggle)  # -> output
# ---------- python_3: Python ----------
__author__ = "Pedersen_Admin"
__version__ = "2021.02.15"

if run:
    with open(cummulative_results_file, "r") as infile:
        content = infile.readlines()
    
    
    output = []
    for i in range(1,len(content)):
        output.append(float(content[i]))
# ---------- end python_3 ----------
python_4 = GhPythonScript(clustering_centers_files=concat_8, run=toggle)  # -> out, P
# ---------- python_4: Python ----------
__author__ = "Pedersen_Admin"
__version__ = "2021.02.10"

import rhinoscriptsyntax as rs
import os 

if run:
    P = []
    with open(clustering_centers_files, "r") as infile:
        content = infile.readlines()
        
    for i in range(len(content)):
        try:
            numbers = content[i].split(" ")
            P.append(rs.AddPoint(float(numbers[0]),float(numbers[1]),float(numbers[2])))
            #P.append(rs.AddPoint(float(numbers[0]),float(numbers[1])))
            
        except: #Last line
            pass
# ---------- end python_4 ----------
python_5 = GhPythonScript(clustering_files=concat_7, run=toggle)  # -> output
# ---------- python_5: Python ----------
__author__ = "Pedersen_Admin"
__version__ = "2021.02.15"

if run:
    with open(clustering_files, "r") as infile:
        content = infile.readlines()
    
    
    output = []
    for i in range(len(content)):
        output.append(float(content[i]))
# ---------- end python_5 ----------
graft = GraftTree(Tree=python_2.M, IncludeEmptyLists=True, IncludeNullItems=True)

# ----
# Rooms
python_6 = GhPythonScript(folder="C:\baseline_test\rooms", run=toggle)  # -> radfiles
# ---------- python_6: Python ----------
__author__ = "Pedersen_Admin"
__version__ = "2021.02.18"

import rhinoscriptsyntax as rs
import os

if run:
    radfiles = []
    for file in os.listdir(folder):
        radfiles.append(folder + "\\" + file)
# ---------- end python_6 ----------
importrad_4 = Honeybee_ImportRad(radianceFile=python_6)  # -> RADMaterials, RADSurfaces; plug-in component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

# ----
# Clustering
heatmap = LBSpatialHeatmap(values=python_5, mesh=graft)  # -> mesh, legend, title, colors, legend_par; plug-in component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
flatten = FlattenTree(Tree=python_4.P, Path="{0}")
cluster = Cluster_2(T=python_5)
bang = ExplodeTree(Data=graft)
bang_2 = ExplodeTree(Data=python_5)
heatmap_2 = LBSpatialHeatmap(values=bang_2, mesh=bang, legend_par=cluster)  # -> mesh, legend, title, colors, legend_par; plug-in component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
mesh = Mesh(heatmap.mesh)
dots = DotDisplay(Point=flatten, Colour=RGB(0, 0, 0), Size=1)

# ---- group: Cummulative results
cluster_2 = Cluster(T=python_3)
# Cummulative result
heatmap_3 = LBSpatialHeatmap(values=python_3, mesh=graft, legend_par=cluster_2)  # -> mesh, legend, title, colors, legend_par; plug-in component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
bang_3 = ExplodeTree(Data=python_3)
bang_4 = ExplodeTree(Data=graft)
heatmap_4 = LBSpatialHeatmap(values=bang_3, mesh=bang_4, legend_par=cluster_2)  # -> mesh, legend, title, colors, legend_par; plug-in component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
mesh_2 = Mesh(heatmap_3.mesh)
vdis = VectorDisplay(Anchor=python.P, Vector=python.N)

# ==== cluster Cluster
T = ClusterInput()
flatten = FlattenTree(Tree=T, Path="{0}")
sort = SortList(Keys=flatten)  # -> Keys, ValuesA
item = ListItem(List=sort.Keys, Index="-1", Wrap=True)
item_2 = ListItem(List=sort.Keys, Index="0", Wrap=True)
panel = Panel(item_2)
panel_2 = Panel(item)
legendpar = LBLegendParameters(min=item_2, max=item)  # -> leg_par; plug-in component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
leg_par = ClusterOutput(legendpar)

# ==== cluster Cluster_2
T = ClusterInput()
flatten = FlattenTree(Tree=T, Path="{0}")
sort = SortList(Keys=flatten)  # -> Keys, ValuesA
item = ListItem(List=sort.Keys, Index="-1", Wrap=True)
item_2 = ListItem(List=sort.Keys, Index="0", Wrap=True)
panel = Panel(item_2)
panel_2 = Panel(item)
addition = Addition(A=panel_2, B="1")
legendpar = LBLegendParameters(min=item_2, max=item, seg_count=addition)  # -> leg_par; plug-in component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
leg_par = ClusterOutput(legendpar)
