# Grasshopper definition display_results.gh (Grasshopper 1.0.7)

# ---- group: Read info json
# Input geometry
python = GhPythonScript(info_json="C:\Simulations\example2\info.json")  # -> out, port, vmt_facade_dst, vmt_rest_dst, context_dst, port_2, rad_mesh_files_list, rad_results_cummulative_list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
# ---------- python: Python ----------
__author__ = "Pedersen_Admin"
__version__ = "2021.02.23"

import json

#Read json
with open(info_json, 'r') as infile:
    json_data = json.load(infile)



vmt_facade_dst = json_data["vmt_facade_dst"]
vmt_rest_dst = json_data["vmt_rest_dst"]
context_dst = json_data["context_dst"]

rad_mesh_files_list = json_data["rad_mesh_files_list"]
rad_points_all = json_data["rad_points_all"]

rad_results_cummulative_list = json_data["rad_results_cummulative_list"]

room_folder = json_data["room_folder"]
facade_count = json_data["facade_count"]

day_mesh_path_list = json_data["day_mesh_path_list"]
day_results_da_list = json_data["day_results_da_list"]

ene_cumm_results_list = json_data["ene_cumm_results_list"]
# ---------- end python ----------

# ----
importrad = Honeybee_ImportRad(radianceFile=python.vmt_facade_dst)  # -> RADMaterials, RADSurfaces; plug-in component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
importrad_2 = Honeybee_ImportRad(radianceFile=python.vmt_rest_dst)  # -> RADMaterials, RADSurfaces; plug-in component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
importrad_3 = Honeybee_ImportRad(radianceFile=python.context_dst)  # -> RADMaterials, RADSurfaces; plug-in component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
edges = BrepEdges(Brep=importrad_3.RADSurfaces)  # -> Naked, Interior, NonManifold
edges_2 = BrepEdges(Brep=[importrad.RADSurfaces, importrad_2.RADSurfaces])  # -> Naked, Interior, NonManifold
preview = CustomPreview(Geometry=edges.Naked, Material=ColourSwatch(SwatchColor=RGB(0, 0, 0)))
preview_2 = CustomPreview(Geometry=[importrad.RADSurfaces, importrad_2.RADSurfaces], Material=ColourSwatch(SwatchColor=RGBA(255, 0, 42, 157)))
preview_3 = CustomPreview(Geometry=importrad_3.RADSurfaces, Material=ColourSwatch(SwatchColor=RGBA(255, 255, 255, 72)))

# ---- group: Radiation mesh
# Radiation analysis
python_2 = GhPythonScript(rad_mesh_files_list=python.rad_mesh_files_list)  # -> out, rh_mesh, rh_centroids, rh_normals
# ---------- python_2: Python ----------
__author__ = "Pedersen_Admin"
__version__ = "2021.02.24"

import json
from ladybug_geometry.geometry3d.face import Mesh3D
from ladybug_rhino.fromgeometry import from_mesh3d, from_point3d

with open(rad_mesh_files_list, 'r') as infile:
    mesh_dict = json.load(infile)

lb_mesh = Mesh3D.from_dict(mesh_dict)
rh_mesh = from_mesh3d(lb_mesh)


lb_centroids = lb_mesh.face_centroids
lb_normals = lb_mesh.face_normals

rh_centroids = []
rh_normals = []
for i in range(len(lb_centroids)):
    rh_centroids.append(from_point3d(lb_centroids[i]))
    rh_normals.append(from_point3d(lb_normals[i]))
# ---------- end python_2 ----------
python_3 = GhPythonScript(rad_results_cummulative_list=python.rad_results_cummulative_list)  # -> output
# ---------- python_3: Python ----------
__author__ = "Pedersen_Admin"
__version__ = "2021.02.15"


with open(rad_results_cummulative_list, "r") as infile:
    content = infile.readlines()


output = []
for i in range(len(content)):
    output.append(float(content[i]))
# ---------- end python_3 ----------
graft = GraftTree(Tree=python_2.rh_mesh, IncludeEmptyLists=True, IncludeNullItems=True)

# ---- group: Legend parameters
cluster = Cluster(T=python_3)

# ---- group: Output legend
panel_2 = Panel("""0
0
0""")
path = ConstructPath(Indices=panel_2)
path_2 = ConstructPath(Indices=panel_2)
branch = TreeBranch(Tree=python_3, Path=path_2, MaintainPaths=True)
branch_2 = TreeBranch(Tree=graft, Path=path, MaintainPaths=True)
heatmap = LBSpatialHeatmap(values=branch, mesh=branch_2, legend_par=cluster)  # -> mesh, legend, title, colors, legend_par; plug-in component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

# ---- group: Output radiation mesh
heatmap_2 = LBSpatialHeatmap(values=python_3, mesh=graft, legend_par=cluster)  # -> mesh, legend, title, colors, legend_par; plug-in component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
mesh = Mesh(heatmap_2.mesh)

# ---- group: Radiation points
vdis = VectorDisplay(Anchor=python_2.rh_centroids, Vector=python_2.rh_normals)

# ---- group: Room selector
number_slider = Slider(0, range=0..3)

# ----
python_4 = GhPythonScript(room_folder=python.room_folder, surf_id=number_slider)  # -> out, window_rooms_rad_files, room_rad_files, vmt_rad_files
# ---------- python_4: Python ----------
__author__ = "Pedersen_Admin"
__version__ = "2021.02.24"

import rhinoscriptsyntax as rs
from os import listdir
from os.path import isfile, join


window_rooms_rad_files = []
room_rad_files = []
vmt_rad_files = []
for f in listdir(room_folder):
    if ("surf_{}".format(int(surf_id)) in f):
        if "__window.rad" in f:
            window_rooms_rad_files.append(join(room_folder, f))
        elif "__room.rad" in f:
            room_rad_files.append(join(room_folder, f))
        elif "__vmt.rad" in f:
            vmt_rad_files.append(join(room_folder, f))
# ---------- end python_4 ----------
number_of_faces = Panel(python.facade_count)
# Rooms
importrad_4 = Honeybee_ImportRad(radianceFile=python_4.window_rooms_rad_files)  # -> RADMaterials, RADSurfaces; plug-in component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
importrad_5 = Honeybee_ImportRad(radianceFile=python_4.room_rad_files)  # -> RADMaterials, RADSurfaces; plug-in component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
importrad_6 = Honeybee_ImportRad(radianceFile=python_4.vmt_rad_files)  # -> RADMaterials, RADSurfaces; plug-in component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
edges_3 = BrepEdges(Brep=importrad_4.RADSurfaces)  # -> Naked, Interior, NonManifold
edges_4 = BrepEdges(Brep=importrad_5.RADSurfaces)  # -> Naked, Interior, NonManifold
edges_5 = BrepEdges(Brep=importrad_6.RADSurfaces)  # -> Naked, Interior, NonManifold
facen = FaceNormals(Mesh=importrad_4.RADSurfaces)  # -> Centers, Normals
facen_2 = FaceNormals(Mesh=importrad_5.RADSurfaces)  # -> Centers, Normals
facen_3 = FaceNormals(Mesh=importrad_6.RADSurfaces)  # -> Centers, Normals

preview_4 = CustomPreview(Geometry=importrad_4.RADSurfaces, Material=ColourSwatch(SwatchColor=RGB(0, 212, 255)))
preview_5 = CustomPreview(Geometry=edges_3.Naked, Material=ColourSwatch(SwatchColor=RGB(0, 0, 0)))
vdis_2 = VectorDisplay(Anchor=facen.Centers, Vector=facen.Normals)

preview_6 = CustomPreview(Geometry=importrad_5.RADSurfaces, Material=ColourSwatch(SwatchColor=RGBA(255, 255, 255, 91)))
vdis_3 = VectorDisplay(Anchor=facen_2.Centers, Vector=facen_2.Normals)
preview_7 = CustomPreview(Geometry=edges_4.Naked, Material=ColourSwatch(SwatchColor=RGB(0, 0, 0)))

preview_8 = CustomPreview(Geometry=importrad_6.RADSurfaces, Material=ColourSwatch(SwatchColor=RGBA(255, 255, 255, 91)))
preview_9 = CustomPreview(Geometry=edges_5.Naked, Material=ColourSwatch(SwatchColor=RGB(0, 0, 0)))

# ---- group: Room selector
number_slider_2 = Slider(3, range=0..3)

# ----
# Visual outputs
python_5 = GhPythonScript(room_folder=python.room_folder, surf_id=number_slider_2)  # -> out, window_rooms_rad_files, room_rad_files, vmt_rad_files; same code as python_4
# Rooms
importrad_7 = Honeybee_ImportRad(radianceFile=python_5.window_rooms_rad_files)  # -> RADMaterials, RADSurfaces; plug-in component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
importrad_8 = Honeybee_ImportRad(radianceFile=python_5.room_rad_files)  # -> RADMaterials, RADSurfaces; plug-in component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
importrad_9 = Honeybee_ImportRad(radianceFile=python_5.vmt_rad_files)  # -> RADMaterials, RADSurfaces; plug-in component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
edges_6 = BrepEdges(Brep=importrad_7.RADSurfaces)  # -> Naked, Interior, NonManifold
edges_7 = BrepEdges(Brep=importrad_8.RADSurfaces)  # -> Naked, Interior, NonManifold
edges_8 = BrepEdges(Brep=importrad_9.RADSurfaces)  # -> Naked, Interior, NonManifold
facen_4 = FaceNormals(Mesh=importrad_7.RADSurfaces)  # -> Centers, Normals
facen_5 = FaceNormals(Mesh=importrad_8.RADSurfaces)  # -> Centers, Normals
facen_6 = FaceNormals(Mesh=importrad_9.RADSurfaces)  # -> Centers, Normals

preview_10 = CustomPreview(Geometry=importrad_7.RADSurfaces, Material=ColourSwatch(SwatchColor=RGB(0, 212, 255)))
preview_11 = CustomPreview(Geometry=edges_6.Naked, Material=ColourSwatch(SwatchColor=RGB(0, 0, 0)))
vdis_4 = VectorDisplay(Anchor=facen_4.Centers, Vector=facen_4.Normals)

preview_12 = CustomPreview(Geometry=importrad_8.RADSurfaces, Material=ColourSwatch(SwatchColor=RGBA(255, 255, 255, 91)))
vdis_5 = VectorDisplay(Anchor=facen_5.Centers, Vector=facen_5.Normals)
preview_13 = CustomPreview(Geometry=edges_7.Naked, Material=ColourSwatch(SwatchColor=RGB(0, 0, 0)))

preview_14 = CustomPreview(Geometry=importrad_9.RADSurfaces, Material=ColourSwatch(SwatchColor=RGBA(255, 255, 255, 91)))
preview_15 = CustomPreview(Geometry=edges_8.Naked, Material=ColourSwatch(SwatchColor=RGB(0, 0, 0)))

# ---- group: Room selector
# Daylight analysis
number_slider_3 = Slider(1, range=0..3)

# ----
python_6 = GhPythonScript(room_folder=python.room_folder, surf_id=number_slider_3)  # -> out, window_rooms_rad_files, room_rad_files, vmt_rad_files; same code as python_4
# Rooms
importrad_10 = Honeybee_ImportRad(radianceFile=python_6.window_rooms_rad_files)  # -> RADMaterials, RADSurfaces; plug-in component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
importrad_11 = Honeybee_ImportRad(radianceFile=python_6.room_rad_files)  # -> RADMaterials, RADSurfaces; plug-in component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
importrad_12 = Honeybee_ImportRad(radianceFile=python_6.vmt_rad_files)  # -> RADMaterials, RADSurfaces; plug-in component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
edges_9 = BrepEdges(Brep=importrad_10.RADSurfaces)  # -> Naked, Interior, NonManifold
edges_10 = BrepEdges(Brep=importrad_11.RADSurfaces)  # -> Naked, Interior, NonManifold
edges_11 = BrepEdges(Brep=importrad_12.RADSurfaces)  # -> Naked, Interior, NonManifold
facen_7 = FaceNormals(Mesh=importrad_10.RADSurfaces)  # -> Centers, Normals
facen_8 = FaceNormals(Mesh=importrad_11.RADSurfaces)  # -> Centers, Normals
facen_9 = FaceNormals(Mesh=importrad_12.RADSurfaces)  # -> Centers, Normals

preview_16 = CustomPreview(Geometry=importrad_10.RADSurfaces, Material=ColourSwatch(SwatchColor=RGB(0, 212, 255)))
preview_17 = CustomPreview(Geometry=edges_9.Naked, Material=ColourSwatch(SwatchColor=RGB(0, 0, 0)))
vdis_6 = VectorDisplay(Anchor=facen_7.Centers, Vector=facen_7.Normals)

preview_18 = CustomPreview(Geometry=importrad_11.RADSurfaces, Material=ColourSwatch(SwatchColor=RGBA(255, 255, 255, 91)))
vdis_7 = VectorDisplay(Anchor=facen_8.Centers, Vector=facen_8.Normals)
preview_19 = CustomPreview(Geometry=edges_10.Naked, Material=ColourSwatch(SwatchColor=RGB(0, 0, 0)))

preview_20 = CustomPreview(Geometry=importrad_12.RADSurfaces, Material=ColourSwatch(SwatchColor=RGBA(255, 255, 255, 91)))
preview_21 = CustomPreview(Geometry=edges_11.Naked, Material=ColourSwatch(SwatchColor=RGB(0, 0, 0)))

# ---- group: Room selector
# Daylight analysis
number_slider_4 = Slider(2, range=0..3)

# ----
python_7 = GhPythonScript(room_folder=python.room_folder, surf_id=number_slider_4)  # -> out, window_rooms_rad_files, room_rad_files, vmt_rad_files; same code as python_4
# Rooms
importrad_13 = Honeybee_ImportRad(radianceFile=python_7.window_rooms_rad_files)  # -> RADMaterials, RADSurfaces; plug-in component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
importrad_14 = Honeybee_ImportRad(radianceFile=python_7.room_rad_files)  # -> RADMaterials, RADSurfaces; plug-in component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
importrad_15 = Honeybee_ImportRad(radianceFile=python_7.vmt_rad_files)  # -> RADMaterials, RADSurfaces; plug-in component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
edges_12 = BrepEdges(Brep=importrad_13.RADSurfaces)  # -> Naked, Interior, NonManifold
edges_13 = BrepEdges(Brep=importrad_14.RADSurfaces)  # -> Naked, Interior, NonManifold
edges_14 = BrepEdges(Brep=importrad_15.RADSurfaces)  # -> Naked, Interior, NonManifold
facen_10 = FaceNormals(Mesh=importrad_13.RADSurfaces)  # -> Centers, Normals
facen_11 = FaceNormals(Mesh=importrad_14.RADSurfaces)  # -> Centers, Normals
facen_12 = FaceNormals(Mesh=importrad_15.RADSurfaces)  # -> Centers, Normals

preview_22 = CustomPreview(Geometry=importrad_13.RADSurfaces, Material=ColourSwatch(SwatchColor=RGB(0, 212, 255)))
preview_23 = CustomPreview(Geometry=edges_12.Naked, Material=ColourSwatch(SwatchColor=RGB(0, 0, 0)))
vdis_8 = VectorDisplay(Anchor=facen_10.Centers, Vector=facen_10.Normals)

preview_24 = CustomPreview(Geometry=importrad_14.RADSurfaces, Material=ColourSwatch(SwatchColor=RGBA(255, 255, 255, 91)))
vdis_9 = VectorDisplay(Anchor=facen_11.Centers, Vector=facen_11.Normals)
preview_25 = CustomPreview(Geometry=edges_13.Naked, Material=ColourSwatch(SwatchColor=RGB(0, 0, 0)))

preview_26 = CustomPreview(Geometry=importrad_15.RADSurfaces, Material=ColourSwatch(SwatchColor=RGBA(255, 255, 255, 91)))
preview_27 = CustomPreview(Geometry=edges_14.Naked, Material=ColourSwatch(SwatchColor=RGB(0, 0, 0)))

python_8 = GhPythonScript(day_results_da_list=python.day_results_da_list, surf_id=number_slider)  # -> out, day_results_da; inputs day_results_da_list: list
# ---------- python_8: Python ----------
__author__ = "Pedersen_Admin"
__version__ = "2021.02.24"

import json
from ladybug_geometry.geometry3d.face import Mesh3D
from ladybug_rhino.fromgeometry import from_mesh3d, from_point3d
from os import listdir
from os.path import isfile, join

day_results_da = []
for f in range(len(day_results_da_list)):
    if ("surf_{}".format(int(surf_id)) in day_results_da_list[f]):
        day_results_da.append(day_results_da_list[f])
# ---------- end python_8 ----------
python_9 = GhPythonScript(day_results_da_list=python.day_results_da_list, surf_id=number_slider_2)  # -> out, day_results_da; inputs day_results_da_list: list; same code as python_8
python_10 = GhPythonScript(day_results_da_list=python.day_results_da_list, surf_id=number_slider_3)  # -> out, day_results_da; inputs day_results_da_list: list; same code as python_8
python_11 = GhPythonScript(day_results_da_list=python.day_results_da_list, surf_id=number_slider_4)  # -> out, day_results_da; inputs day_results_da_list: list; same code as python_8

legendpar = LBLegendParameters(min="0", max="100")  # -> leg_par; plug-in component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

legendpar_2 = LBLegendParameters(min="0", max="100")  # -> leg_par; plug-in component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

legendpar_3 = LBLegendParameters(min="0", max="100")  # -> leg_par; plug-in component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

legendpar_4 = LBLegendParameters(min="0", max="100")  # -> leg_par; plug-in component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

python_12 = GhPythonScript(ene_cumm_results_list=python.ene_cumm_results_list, surf_id=number_slider_2)  # -> out, ene_cumm_results; inputs ene_cumm_results_list: list
# ---------- python_12: Python ----------
__author__ = "Pedersen_Admin"
__version__ = "2021.02.24"

import json
from ladybug_geometry.geometry3d.face import Mesh3D
from ladybug_rhino.fromgeometry import from_mesh3d, from_point3d
from os import listdir
from os.path import isfile, join

ene_cumm_results = []
for f in range(len(ene_cumm_results_list)):
    if ("surf_{}".format(int(surf_id)) in ene_cumm_results_list[f]):
        ene_cumm_results.append(ene_cumm_results_list[f])
# ---------- end python_12 ----------
# Energy analysis
panel_3 = Panel(python_12.ene_cumm_results)

# ---- group: Radiation mesh
python_13 = GhPythonScript(day_mesh_path_list=python.day_mesh_path_list, surf_id=number_slider)  # -> out, day_mesh_path; inputs day_mesh_path_list: list
# ---------- python_13: Python ----------
__author__ = "Pedersen_Admin"
__version__ = "2021.02.24"

import json
from ladybug_geometry.geometry3d.face import Mesh3D
from ladybug_rhino.fromgeometry import from_mesh3d, from_point3d
from os import listdir
from os.path import isfile, join

day_mesh_path = []
for f in range(len(day_mesh_path_list)):
    if ("surf_{}".format(int(surf_id)) in day_mesh_path_list[f]):
        day_mesh_path.append(day_mesh_path_list[f])
# ---------- end python_13 ----------
python_14 = GhPythonScript(day_results_da=python_8.day_results_da)  # -> output
# ---------- python_14: Python ----------
__author__ = "Pedersen_Admin"
__version__ = "2021.02.15"


with open(day_results_da, "r") as infile:
    content = infile.readlines()


output = []
for i in range(len(content)):
    output.append(float(content[i]))
# ---------- end python_14 ----------

# ----
python_15 = GhPythonScript(day_mesh_path=python_13.day_mesh_path)  # -> out, rh_mesh, rh_centroids, rh_normals
# ---------- python_15: Python ----------
__author__ = "Pedersen_Admin"
__version__ = "2021.02.24"

import json
from ladybug_geometry.geometry3d.face import Mesh3D
from ladybug_rhino.fromgeometry import from_mesh3d, from_point3d
from os import listdir
from os.path import isfile, join


with open(day_mesh_path, 'r') as infile:
    mesh_dict = json.load(infile)

lb_mesh = Mesh3D.from_dict(mesh_dict)
rh_mesh = from_mesh3d(lb_mesh)


lb_centroids = lb_mesh.face_centroids
lb_normals = lb_mesh.face_normals

rh_centroids = []
rh_normals = []
for i in range(len(lb_centroids)):
    rh_centroids.append(from_point3d(lb_centroids[i]))
    rh_normals.append(from_point3d(lb_normals[i]))
# ---------- end python_15 ----------

# ---- group: Radiation mesh (continued)
graft_2 = GraftTree(Tree=python_15.rh_mesh, IncludeEmptyLists=True, IncludeNullItems=True)

# ---- group: Daylight points
vdis_10 = VectorDisplay(Anchor=python_15.rh_centroids, Vector=python_15.rh_normals)

# ---- group: Output radiation mesh
heatmap_3 = LBSpatialHeatmap(values=python_14, mesh=graft_2, legend_par=legendpar)  # -> mesh, legend, title, colors, legend_par; plug-in component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

# ---- group: Radiation mesh
# Daylight analysis
python_16 = GhPythonScript(day_mesh_path_list=python.day_mesh_path_list, surf_id=number_slider_2)  # -> out, day_mesh_path; inputs day_mesh_path_list: list; same code as python_13
python_17 = GhPythonScript(day_results_da=python_9.day_results_da)  # -> output; same code as python_14

# ----
python_18 = GhPythonScript(day_mesh_path=python_16.day_mesh_path)  # -> out, rh_mesh, rh_centroids, rh_normals; same code as python_15

# ---- group: Radiation mesh (continued)
graft_3 = GraftTree(Tree=python_18.rh_mesh, IncludeEmptyLists=True, IncludeNullItems=True)

# ---- group: Daylight points
vdis_11 = VectorDisplay(Anchor=python_18.rh_centroids, Vector=python_18.rh_normals)

# ---- group: Output radiation mesh
heatmap_4 = LBSpatialHeatmap(values=python_17, mesh=graft_3, legend_par=legendpar_2)  # -> mesh, legend, title, colors, legend_par; plug-in component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

# ---- group: Radiation mesh
python_19 = GhPythonScript(day_mesh_path_list=python.day_mesh_path_list, surf_id=number_slider_3)  # -> out, day_mesh_path; inputs day_mesh_path_list: list; same code as python_13
python_20 = GhPythonScript(day_results_da=python_10.day_results_da)  # -> output; same code as python_14

# ----
python_21 = GhPythonScript(day_mesh_path=python_19.day_mesh_path)  # -> out, rh_mesh, rh_centroids, rh_normals; same code as python_15

# ---- group: Radiation mesh (continued)
graft_4 = GraftTree(Tree=python_21.rh_mesh, IncludeEmptyLists=True, IncludeNullItems=True)

# ---- group: Daylight points
vdis_12 = VectorDisplay(Anchor=python_21.rh_centroids, Vector=python_21.rh_normals)

# ---- group: Output radiation mesh
heatmap_5 = LBSpatialHeatmap(values=python_20, mesh=graft_4, legend_par=legendpar_3)  # -> mesh, legend, title, colors, legend_par; plug-in component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

# ---- group: Radiation mesh
# Daylight analysis
python_22 = GhPythonScript(day_mesh_path_list=python.day_mesh_path_list, surf_id=number_slider_4)  # -> out, day_mesh_path; inputs day_mesh_path_list: list; same code as python_13
python_23 = GhPythonScript(day_results_da=python_11.day_results_da)  # -> output; same code as python_14

# ----
python_24 = GhPythonScript(day_mesh_path=python_22.day_mesh_path)  # -> out, rh_mesh, rh_centroids, rh_normals; same code as python_15

# ---- group: Radiation mesh (continued)
graft_5 = GraftTree(Tree=python_24.rh_mesh, IncludeEmptyLists=True, IncludeNullItems=True)

# ---- group: Daylight points
vdis_13 = VectorDisplay(Anchor=python_24.rh_centroids, Vector=python_24.rh_normals)

# ---- group: Output radiation mesh
heatmap_6 = LBSpatialHeatmap(values=python_23, mesh=graft_5, legend_par=legendpar_4)  # -> mesh, legend, title, colors, legend_par; plug-in component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

# ==== cluster Cluster
T = ClusterInput()
flatten = FlattenTree(Tree=T, Path="{0}")
sort = SortList(Keys=flatten)  # -> Keys, ValuesA
item = ListItem(List=sort.Keys, Index="-1", Wrap=True)
item_2 = ListItem(List=sort.Keys, Index="0", Wrap=True)
panel = Panel(item_2)
panel_2 = Panel(item)
legendpar = LBLegendParameters(min=item_2, max=item)  # -> leg_par; plug-in component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
leg_par = ClusterOutput(legendpar)
