# Grasshopper definition generate_rad_3.gh (Grasshopper 1.0.7)

panel = Panel("https://www.energyplus.net/weather-download/europe_wmo_region_6/DNK//DNK_Copenhagen.061800_IWEC/all")

# ---- group: Output folder
should_not_contain_whitespace = Panel("C:\Simulation")

# ---- group: Window parameters
number_slider = Slider(1.9, range=0..4)
number_slider_2 = Slider(2.3, range=0..4)
number_slider_3 = Slider(0, range=0..4)
number_slider_4 = Slider(0.9, range=0..4)
number_slider_5 = Slider(0.39, range=0..1)
panel_2 = Panel("True")

# ---- group: Daylight grid parameters
number_slider_6 = Slider(3, range=0.2..3)
toggle = BooleanToggle(False)
panel_3 = Panel("0.85")

# ---- group: Write simulation data
toggle_2 = BooleanToggle(True)

# ---- group: Context
brep = Brep([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])

# ---- group: Test
brep_2 = Brep([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])

# ---- group: Volumes
brep_3 = Brep([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])

# ----
epwmap = LBEPWmap(epw_map=Toggle(False))  # -> report; plug-in component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
downloadepw = LBDownloadWeather(weather_URL=panel, folder=should_not_contain_whitespace)  # -> epw_file, stat_file, ddy_file; plug-in component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
panel_4 = Panel(downloadepw.epw_file)

opaquemod = HBOpaqueModifier(name="Floor_rad_mat", reflect="0.2", spec="0", rough="0")  # -> modifier; plug-in component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
opaquemod_2 = HBOpaqueModifier(name="Ceiling_rad_mat", reflect="0.8", spec="0", rough="0")  # -> modifier; plug-in component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
# Radiance modifiers
opaquemod_3 = HBOpaqueModifier(name="Wall_rad_mat", reflect="0.5", spec="0", rough="0")  # -> modifier; plug-in component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
interiorsubset = HBInteriorModifierSubset(interior_wall=opaquemod_3, ceiling=opaquemod_2, interior_floor=opaquemod)  # -> interior_set; plug-in component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
exteriorsubset = HBExteriorModifierSubset(exterior_wall=opaquemod_3, exterior_roof=opaquemod_2, exposed_floor=opaquemod)  # -> exterior_set; plug-in component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

# ---- group: Windows by ratio
roomsolid = HBRoomFromSolid(geo=flatten(brep_2), conditioned=True)  # -> report, rooms; plug-in component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
aperturesbyratio = HBAperturesByRatio(
    hb_objs=flatten(roomsolid.rooms),
    ratio=number_slider_5,
    subdivide=panel_2,
    win_height=number_slider,
    sill_height=number_slider_4,
    horiz_separ=number_slider_2,
    vert_separ=number_slider_3)  # -> report, hb_objs; plug-in component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

# ---- group: Context
opaquemod_4 = HBOpaqueModifier(name="Context_rad_mat", reflect="0.2", spec="0", rough="0")  # -> modifier; plug-in component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
shade = HBShade(geo=brep, rad_mod=opaquemod_4)  # -> report, shades; plug-in component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

# ----
searchconstrs = HBSearchConstructions()  # -> opaque_constrs, window_constrs, shade_constrs; plug-in component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
item = ListItem(List=searchconstrs.opaque_constrs, Index=Slider(76, range=0..201), Wrap=True)
panel_5 = Panel(searchconstrs.opaque_constrs)
decnstrconstr = HBDeconstructConstruction(constr=item)  # -> materials, layers, r_val_si, r_val_ip, u_fac_si, u_fac_ip, t_sol, t_vis; plug-in component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
u_value = Panel(decnstrconstr.u_fac_si)
panel_6 = Panel(item)
layers = Panel(decnstrconstr.layers)

# ---- group: Vizualizing/preview of model
vizbytype = HBVisualizeByType(hb_objs=aperturesbyratio.hb_objs)  # -> walls, interior_walls, roofs, ceilings, exterior_floors, interior_floors, air_walls, apertures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; plug-in component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

# ----
panel_7 = Panel("C:\Users\Pedersen_Admin\OneDrive - Perkins and Will\Desktop\Simulation\Raytracing\Daylight\Radiance\model\scene\shades.rad")

versioner = LBVersioner(update=Toggle(False), version="1.2.0")  # -> Vviiiiiz; plug-in component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

# ---- group: Window
searchconstrs_2 = HBSearchConstructions()  # -> opaque_constrs, window_constrs, shade_constrs; plug-in component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
panel_8 = Panel(searchconstrs_2.window_constrs)
item_2 = ListItem(List=searchconstrs_2.window_constrs, Index=Slider(7, range=0..201), Wrap=True)
decnstrconstr_2 = HBDeconstructConstruction(constr=item_2)  # -> materials, layers, r_val_si, r_val_ip, u_fac_si, u_fac_ip, t_sol, t_vis; plug-in component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
panel_9 = Panel(item_2)
layers_2 = Panel(decnstrconstr_2.layers)
t_sol = Panel(decnstrconstr_2.t_sol)
t_vis = Panel(decnstrconstr_2.t_vis)
u_value_2 = Panel(decnstrconstr_2.u_fac_si)

# ----
glassmod = HBGlassModifier(name="Glass_rad_mat_daylight", trans=decnstrconstr_2.t_vis)  # -> modifier; plug-in component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
subfacesubset = HBSubfaceModifierSubset(window=glassmod)  # -> subface_set; plug-in component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
modifierset = HBModifierSet(exterior_subset=exteriorsubset, interior_subset=interiorsubset, subface_subset=subfacesubset)  # -> mod_set; plug-in component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

glassmod_2 = HBGlassModifier(name="Glass_rad_mat_energy", trans=decnstrconstr_2.t_sol)  # -> modifier; plug-in component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
subfacesubset_2 = HBSubfaceModifierSubset(window=glassmod_2)  # -> subface_set; plug-in component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
modifierset_2 = HBModifierSet(exterior_subset=exteriorsubset, interior_subset=interiorsubset, subface_subset=subfacesubset_2)  # -> mod_set; plug-in component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

# ---- group: Applying Radiance modifiers to rooms
# Daylight - raytracing
applymodset = HBApplyModifierSet(rooms=aperturesbyratio.hb_objs, mod_set=modifierset)  # -> rooms; plug-in component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
model = HBModel(rooms=flatten(applymodset), shades=flatten(shade.shades), name="Daylight")  # -> report, model; plug-in component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

# Energy - raytracing
applymodset_2 = HBApplyModifierSet(rooms=aperturesbyratio.hb_objs, mod_set=modifierset_2)  # -> rooms; plug-in component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
model_2 = HBModel(rooms=flatten(applymodset_2), shades=flatten(shade.shades), name="Energy")  # -> report, model; plug-in component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

# ---- group: Radiance grids
gridrooms = HBSensorGridFromRooms(rooms=applymodset, grid_size=number_slider_6, dist_floor=panel_3, quad_only=toggle)  # -> grid, points, mesh; plug-in component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
facen = FaceNormals(Mesh=gridrooms.mesh)  # -> Centers, Normals
vdis = VectorDisplay(Anchor=facen.Centers, Vector=facen.Normals)
flatten = FlattenTree(Tree=gridrooms.points, Path="{0}")
assigngridsviews = HBAssignGridsAndViews(model=model.model, grids=flatten(gridrooms.grid))  # -> model; plug-in component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
lng = ListLength(List=flatten)
panel_10 = Panel(lng)

# ----
concat = Concatenate(FragmentA=should_not_contain_whitespace, FragmentB="\ISO13790")
concat_2 = Concatenate(FragmentA=concat, FragmentB="\info.pkl")
python = GhPythonScript(
    rooms=aperturesbyratio.hb_objs,
    U_wall=decnstrconstr.u_fac_si,
    U_window=decnstrconstr_2.u_fac_si,
    output_folder=concat,
    output_filename=concat_2,
    dump=toggle_2)  # -> out; inputs rooms: list
# ---------- python: Python ----------
__author__ = "Pedersen_Admin"
__version__ = "2021.04.19"

import rhinoscriptsyntax as rs
import pickle
import os

rooms = []

for room in _rooms:
    name = room.identifier
    exposed_area = room.exterior_wall_area
    floor_area = room.floor_area
    ext_wall_area = room.exterior_wall_area - room.exterior_aperture_area
    window_area = room.exterior_aperture_area
    
    a = {"name": name, 
    "floor_area": floor_area, 
    "exposed_area": exposed_area, 
    "ext_wall_area": ext_wall_area, 
    "window_area": window_area}
    
    rooms.append(a)


if dump:
    if not os.path.exists(output_folder):
        os.makedirs(output_folder)
    with open(output_filename, "wb") as outfile:
        pickle.dump(rooms, outfile)
# ---------- end python ----------

importrad = Honeybee_ImportRad(radianceFile=panel_7)  # -> RADMaterials, RADSurfaces; plug-in component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

panel_11 = Panel(decnstrconstr_2.r_val_si)
flatten_2 = FlattenTree(Tree=[panel_11, "0.13", "0.04"], Path="{0}")
ma = MassAddition(Input=flatten_2)  # -> Result, PartialResults
panel_12 = Panel(ma.Result)
division = Division(A="1", B=ma.Result)
panel_13 = Panel(division)

# ---- group: Generate grid behind every window
python_2 = GhPythonScript(rooms=applymodset_2, grid_size="5", dist_window="0.01")  # -> grid, points, mesh, normals; inputs rooms: list
# ---------- python_2: Python ----------
__author__ = "Pedersen_Admin"
__version__ = "2021.04.19"

import rhinoscriptsyntax as rs
try:  # import the honeybee-radiance dependencies
    from honeybee_radiance.sensorgrid import SensorGrid
    from ladybug_rhino.fromgeometry import from_mesh3d, from_point3d
except ImportError as e:
    raise ImportError('\nFailed to import honeybee_radiance:\n\t{}'.format(e))


grid = []
points = []
mesh = []
normals = []

for room in _rooms:
    for face in room.faces:
        for aperture in face.apertures:
            s_grid = SensorGrid.from_face3d(
            aperture.identifier + "_SensorGrid",
            [aperture.geometry],
            x_dim = float(_grid_size), 
            y_dim=None,
            offset = -float(_dist_window))
            
            grid.append(s_grid)
            mesh.append(from_mesh3d(s_grid.mesh))
            points.append(s_grid.mesh.face_centroids)
            normals.append(s_grid.mesh.face_normals)
# ---------- end python_2 ----------

# ----
facen_2 = FaceNormals(Mesh=python_2.mesh)  # -> Centers, Normals
vdis_2 = VectorDisplay(Anchor=facen_2.Centers, Vector=facen_2.Normals)

flatten_3 = FlattenTree(Tree=python_2.points, Path="{0}")
assigngridsviews_2 = HBAssignGridsAndViews(model=model_2.model, grids=flatten(python_2.grid))  # -> model; plug-in component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
lng_2 = ListLength(List=flatten_3)
panel_14 = Panel(lng_2)

concat_3 = Concatenate(FragmentA=should_not_contain_whitespace, FragmentB="\Raytracing")
modeltorad = HBModelToRadFolder(model=[assigngridsviews, assigngridsviews_2], folder=concat_3, write=toggle_2)  # -> report, folder; plug-in component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
