# Grasshopper definition honeybeeplus_daylight.gh (Grasshopper 1.0.7)

radiance_path = Panel("C:\Radiance")
accelerad_path = Panel("C:\Accelerad")

# ---- group: Run on CPU or GPU
toggle = BooleanToggle(False)
# Hardware control
toggle_2 = BooleanToggle(False)

# ----
# Input
simulation_folder_input_and_output = Panel("C:\Users\Pedersen_Admin\OneDrive - Perkins and Will\Documents\GitHub\VMT\frontend")

# ---- group: Modify batch file
modify_batch_file = GhPythonScript(run_on_CPU=toggle_2, run_on_GPU=toggle, radiance_path=radiance_path, accelerad_path=accelerad_path)  # -> out
# ---------- modify_batch_file: Python ----------
__author__ = "Tubsp"
__version__ = "2021.02.05"

import rhinoscriptsyntax as rs
import shutil
import os


#Input check
if run_on_CPU and run_on_GPU:
    raise Exception("Not possible to run on both CPU and GPU at the same time")


#Creating paths
radiance_path = radiance_path.lower()
accelerad_path = accelerad_path.lower()
radiance_backup_path = accelerad_path + "\\radiance_backup"



#Check that backup folder exists
if run_on_CPU or run_on_GPU:
    if not os.path.isdir(radiance_backup_path):
        shutil.copytree(radiance_path, radiance_backup_path)
    
    accelerad_files = [
    "accelerad_rcontrib.exe",
    "accelerad_rfluxmtx.exe",
    "accelerad_rpict.exe",
    "accelerad_rtrace.exe"]
    
    radiance_files = [
    "rcontrib.exe",
    "rfluxmtx.exe",
    "rpict.exe",
    "rtrace.exe"]
    
    radiance_backup_files = ["0", "0", "0", "0"]
    
    for i in range(len(accelerad_files)):
        accelerad_files[i] = accelerad_path + "\\bin\\" + accelerad_files[i]
        radiance_backup_files[i] = radiance_backup_path + "\\bin\\" + radiance_files[i]
        radiance_files[i] = radiance_path + "\\bin\\" + radiance_files[i]
    
    
    accelerad_support_files = []
    for root, dirs, files in os.walk(accelerad_path):
        for name in files:
            if (accelerad_path + "\\bin" in root) or (accelerad_path + "\\lib" in root):
                if not any(name in s for s in accelerad_files):
                   accelerad_support_files.append(os.path.join(root, name))
                   #print(os.path.join(root, name))
    
    
    for i in range(len(accelerad_support_files)):
        shutil.copyfile(accelerad_support_files[i],
        accelerad_support_files[i].replace(accelerad_path,radiance_path))


#Run on CPU
if run_on_CPU:
    for i in range(len(radiance_backup_files)):
        shutil.copyfile(radiance_backup_files[i],radiance_files[i])
    print("Ready to run on CPU (Radiance)")

#Run on GPU
if run_on_GPU:
    for i in range(len(accelerad_files)):
        shutil.copyfile(accelerad_files[i], radiance_files[i])
    print("Ready to run on GPU (Accelerad)")
# ---------- end modify_batch_file ----------
panel = Panel(modify_batch_file)

# ---- group: Rest of zone
zone = Brep([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])

# ---- group: Window
brep = Brep(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)

# ---- group: Floor
brep_2 = Brep(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)

# ----
context = Brep([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])

# ---- group: Ext. wall
brep_3 = Brep([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])

# ----
facen = FaceNormals(Mesh=brep)  # -> Centers, Normals
vdis = VectorDisplay(Anchor=facen.Centers, Vector=facen.Normals)

panel_4 = Panel("""\Sources\00001.xml
\Sources\ven0.xml
\Sources\ven45.xml""")
bsdf_names = Panel("""clear
ven0
ven45""")
concat = Concatenate(FragmentA=simulation_folder_input_and_output, FragmentB=panel_4)
bsdf_files = Panel(concat)

concat_2 = Concatenate(FragmentA=simulation_folder_input_and_output, FragmentB="\Sources\DNK_Copenhagen.061800_IWEC.epw")
epw_file = Panel(concat_2)

split = SplitList(List=bsdf_files, Index="1")  # -> ListA, ListB
split_2 = SplitList(List=bsdf_names, Index="1")  # -> ListA, ListB
radbsdfmat = HoneybeePlus_RadianceBSDFMaterial(xmlfile=split.ListB, up_vec=Vector(0.01, 0.01, 1), thickness=0)  # -> material; disabled; plug-in component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
radbsdfmat_2 = HoneybeePlus_RadianceBSDFMaterial(xmlfile=split.ListA, up_vec=Vector(0.01, 0.01, 1), thickness=0)  # -> material; plug-in component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
data = Data(brep)
wingroupstate = HoneybeePlus_WindowGroupState(name=split_2.ListB, rad_mat=radbsdfmat)  # -> report, state; disabled; plug-in component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
facen_2 = FaceNormals(Mesh=data)  # -> Centers, Normals
hbwingroup = HoneybeePlus_HoneybeeWindowGroup(geo=data, name="Window_88", rad_mat=radbsdfmat_2, states=wingroupstate.state)  # -> report, HB_win_group; plug-in component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
vdis_2 = VectorDisplay(Anchor=facen_2.Centers, Vector=facen_2.Normals)
wires = BrepWireframe(Brep=data, Density=-1)
panel_5 = Panel(hbwingroup.HB_win_group)
preview = CustomPreview(Geometry=data, Material=ColourSwatch(SwatchColor=RGBA(0, 144, 255, 145)))

data_2 = Data(brep_2)
genpts = LBGeneratePointGrid(geometry=data_2, grid_size="0.47", offset_dist="0.85")  # -> points, vectors, face_areas, graft(mesh); plug-in component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
area = Area(Geometry=data_2)  # -> Area, Centroid
panel_6 = Panel(area.Area)
analysisgrid = HoneybeePlus_AnalysisGrid(name="test_points_88", test_points=genpts.points, pts_vectors=genpts.vectors)  # -> analysis_grid; plug-in component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
vdis_3 = VectorDisplay(Anchor=genpts.points, Vector=genpts.vectors)

# ----
# Daylight analysis
panel_7 = Panel("SkyMatrix")
wea = HoneybeePlus_WEAFromEPW(epw_file=epw_file)  # -> wea; plug-in component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
skymatrix = HoneybeePlus_SkyMatrix(name=panel_7, north=0, wea=wea, density=1)  # -> skymtx; plug-in component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

data_3 = Data(brep_3)
data_4 = Data([zone, brep_2])
hbsurface = HoneybeePlus_HoneybeeSurface(geo=data_4)  # -> report, HB_srf; plug-in component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
hbsurface_2 = HoneybeePlus_HoneybeeSurface(geo=data_3)  # -> report, HB_srf; plug-in component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
wires_2 = BrepWireframe(Brep=[data_4, data_3], Density=-1)
preview_2 = CustomPreview(Geometry=[data_4, data_3], Material=ColourSwatch(SwatchColor=RGB(255, 0, 0)))

# ---- group: Write
toggle_3 = BooleanToggle(False)

# ---- group: Run
toggle_4 = BooleanToggle(False)

# ----
data_5 = Data(simulation_folder_input_and_output)

data_6 = Data(context)
radopaquemat = HoneybeePlus_RadianceOpaqueMaterial(name="Context_mat", reflect="0.2", spec=0, rough=0)  # -> material; plug-in component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
hbsurface_3 = HoneybeePlus_HoneybeeSurface(geo=data_6, names="Context", rad_mat=radopaquemat)  # -> report, HB_srf; plug-in component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
wires_3 = BrepWireframe(Brep=data_6, Density=-1)
hbtorad = HoneybeePlus_WriteHBObjectsToRadiance(HB_objects=hbsurface_3.HB_srf, folder=data_5, file_name="context.rad", write="True")  # -> rad_file; plug-in component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
preview_3 = CustomPreview(Geometry=data_6, Material=ColourSwatch(SwatchColor=RGB(150, 150, 150)))
radscene = HoneybeePlus_RadianceScene(rad_files=hbtorad, copy_local="True", overwrite="True")  # -> rad_scene; plug-in component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

radpargridbased = HoneybeePlus_RadianceParametersGridBased(complexity=Slider(2, range=0..2), recipe_type="2")  # -> report, rad_par, vmtx_par, dmtx_par, smtx_par; plug-in component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
d_matrix = Panel(radpargridbased.dmtx_par)
v_matrix = Panel(radpargridbased.vmtx_par)

threephasegbrecipe = HoneybeePlus_GridBasedThreePhaseDaylightRecipe(
    skymtx=skymatrix,
    analysis_grids=analysisgrid,
    analysis_type="0",
    vmtx_par=radpargridbased.vmtx_par,
    dmtx_par=radpargridbased.dmtx_par,
    reuse_vmtx=False,
    reuse_dmtx=False)  # -> analysis_recipe; plug-in component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

data_7 = Data([hbsurface.HB_srf, hbsurface_2.HB_srf, hbwingroup.HB_win_group])
runradiance = HoneybeePlus_RunRadianceAnalysis(
    analysis_recipe=threephasegbrecipe,
    HB_objects=data_7,
    rad_scene=radscene,
    folder=data_5,
    name="DaylightAnalysis",
    write=toggle_3,
    run=toggle_4)  # -> report, legend_par, outputs; plug-in component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

python = GhPythonScript()  # -> out, year
# ---------- python: Python ----------
__author__ = "Pedersen_Admin"
__version__ = "2021.03.01"

import rhinoscriptsyntax as rs

weekday = [0]*8 + [1]*9 + [0]*7
weekend = [0]*24

week = weekday*5+weekend*2

year = week*52 + weekend
# ---------- end python ----------
occschedule = HoneybeePlus_OccupancySchedule(values=python.year)  # -> schedule; plug-in component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
panel_9 = Panel(occschedule)
sda = HoneybeePlus_SpatialDaylightAutonomy(analysis_grid=runradiance.outputs, occ_schedule=occschedule, threshold="300", target_DA=50)  # -> report, sDA, DA, prblm_pts; plug-in component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
panel_10 = Panel(sda.report)
panel_11 = Panel(sda.DA)
# Output
heatmap = LBSpatialHeatmap(values=sda.DA, mesh=genpts.mesh)  # -> mesh, legend, title, colors, legend_par; plug-in component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
