# Grasshopper definition honeybeeplus_radiation.gh (Grasshopper 1.0.7)
# plug-ins: MeshEdit Components

brep = Brep(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)

radpargridbased = HoneybeePlus_RadianceParametersGridBased(complexity=Slider(0, range=0..2), recipe_type="1")  # -> report, rad_par, vmtx_par, dmtx_par, smtx_par; plug-in component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
d_matrix = Panel(radpargridbased.dmtx_par)

area = Area()  # -> Area, Centroid
genpts = LBGeneratePointGrid(geometry=brep, grid_size="4", offset_dist="0.05")  # -> points, vectors, face_areas, graft(mesh); plug-in component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
panel_2 = Panel(area.Area)
facen = FaceNormals(Mesh=genpts.mesh)  # -> Centers, Normals
analysisgrid = HoneybeePlus_AnalysisGrid(name="facade_points_88", test_points=genpts.points, pts_vectors=genpts.vectors)  # -> analysis_grid; plug-in component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
vdis = VectorDisplay(Anchor=facen.Centers, Vector=facen.Normals)

radpargridbased_2 = HoneybeePlus_RadianceParametersGridBased(complexity=Slider(0, range=0..2), recipe_type="1")  # -> report, rad_par, vmtx_par, dmtx_par, smtx_par; plug-in component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
v_matrix = Panel(radpargridbased_2.vmtx_par)
d_matrix_2 = Panel(radpargridbased_2.dmtx_par)

panel_3 = Panel("C:\Users\Pedersen_Admin\OneDrive - Perkins and Will\Documents\GitHub\VMT\database\smx\IWEC\Denmark\Copenhagen\DNK_Copenhagen.061800_IWEC.epw")
wea = HoneybeePlus_WEAFromEPW(epw_file=panel_3)  # -> wea; plug-in component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
skymatrix = HoneybeePlus_SkyMatrix(name="SkyMatrix_88", north=0, wea=wea, density=1)  # -> skymtx; plug-in component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

mesh = Mesh(genpts.mesh)
explode = MeshExplode(Mesh=mesh, Interpolate=False)
# Honeybee Radiation Simulation
panel_4 = Panel(explode)
flatten = FlattenTree(Tree=analysisgrid, Path="{0}")

annualradrecipe = HoneybeePlus_AnnualRadiationRecipe(skymtx=skymatrix, analysis_grids=flatten, dmtx_par=radpargridbased_2.dmtx_par, reuse_dmtx="True")  # -> analysis_recipe; plug-in component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

brep_2 = Brep([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])
hbsurface = HoneybeePlus_HoneybeeSurface(geo=brep_2)  # -> report, HB_srf; plug-in component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

panel_5 = Panel("C:\Users\Pedersen_Admin\OneDrive - Perkins and Will\Documents\GitHub\VMT\frontend")
data = Data(hbsurface.HB_srf)
runradiance = HoneybeePlus_RunRadianceAnalysis(
    analysis_recipe=annualradrecipe,
    HB_objects=data,
    folder=panel_5,
    name="RadiationAnalysis",
    write=Toggle(False),
    run=Toggle(False))  # -> report, legend_par, outputs; plug-in component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

panel_6 = Panel(genpts.mesh)
cumvalue = HoneybeePlus_CumulativeValue(analysis_grid=runradiance.outputs)  # -> report, values; plug-in component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
panel_7 = Panel(cumvalue.values)
flatten_2 = FlattenTree(Tree=cumvalue.values, Path="{0}")
sort = SortList(Keys=flatten_2)  # -> Keys, ValuesA
item = ListItem(List=sort.Keys, Index="-1", Wrap=True)
item_2 = ListItem(List=sort.Keys, Index="0", Wrap=True)
panel_8 = Panel(sort.Keys)
panel_9 = Panel(item_2)
panel_10 = Panel(item)
legendpar = LBLegendParameters(min=item_2, max=item)  # -> leg_par; plug-in component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
heatmap = LBSpatialHeatmap(values=cumvalue.values, mesh=genpts.mesh, legend_par=legendpar)  # -> mesh, legend, title, colors, legend_par; plug-in component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
